% Simulink data dictionary AS_DataDictionary.sldd

PIPipelength = 2000
PIDiameter = 21
T_room = 20
L_to_m3 = 0.001
P_muscle = 0
cmH2O_to_Pa = 98.0665
FRC = 2
T_body = 37
D_trachea = 0.015
L_trachea = 0.15
D_tube = 0.01
L_tube = 1
RH_room = 0.1
O2Atmosfpere = 23.5
O2_OutputDia = 6
Blower_OutputDia = 15
O2_InletLenth = 40
V_SensorBank = 400000
Blower_InputDia = 17
CheckValve_Restriction_Dia = 12
Exhalation_Restrict_Dia = 37
Exhalation_Opening_Height = 4
P_inlet = 500000
P_intermidiate = 100000
O2_buffertank = 90000
TempratureConverter = 273
P_atmosphere = 101325
BlowerMaxFlow = 440
mmsqTomsq = 1.0e-6
P_max = 105247.66
O2_InputPressure = 601325
O2_IntermediatePressure = 301325
P_max_Gauge = 3922.66
E_respiratory = 148.4649
R_respiratory = 39.99644
A_lungs = 0.01
D_mask_tube = 22