% Requirement links of BiPAP_Architecture.slx (R2021a)

block :13 implements URS.slreqx#6: SyOPS-65
block :16 implements URS.slreqx#4
block :2 implements URS.slreqx#8: SyOPS-67
block :32 implements URS.slreqx#5: SyOPS-63
block :35 implements URS.slreqx#1
block :35 implements URS.slreqx#4
block :39 implements URS.slreqx#9: SyOPS-68