# Requirement set URS (R2021a)
This is the specifications that have been stated within the URS for th ventilator and will be assigned to the model.

## 1 [SysOP-61] Power Supply to all Sub-systems
The power supply sub-system shall be capable of providing electrical power to all the sub-systems of the BVS
Keywords: Power Supply

### 1.1 [SysOP-61-C1] Main on/off
The system shall allow for the main on/off switch to activate standby mode, secondary function to turn the device on from standby mode.

### 1.2 [SysOP-61-C2] Run Time
The system shall be able to run for a minimum of 14 days without failure and/or maintenance.

### 1.3 [SysOP-61-C3] Mains Power
The system shall work from standard (South Africa 2021) 220 Volt (V) Alternating Current (AC) 50 Hertz (Hz) wall socket.

### 1.4 [SysOP-61-C4] Cable length
The system shall be provided with a mains cable that is three meters long.

### 1.5 [SysOP-61-C5] Mains Connector
The mains cable shall be fitted with SANS 164-4:2018 complient 15A three prong plug.

### 1.6 [SysOP-61-C6] Cable Prongs
The earth pin shall be fitted to the top with a red cover.

### 1.7 [SysOP-61-C7] Power Failure
In the case of power failure the system shall be able to switch from AC main power to battery operated mode.

### 1.8 [SysOP-61-C8] Power Resume
The system shall switch from battery operating power to AC mains power when power is reconnected to the system.

### 1.9 [SysOP-61-C9] Battery Run Time
The system shall be able to provide uninteruprted power supply from battery backup for a time period of atleast an hour when main power supply fails (NVPF3.16.1).

### 1.10 [SysOP-61-C10] Electrical Safety
The systems shall be complient with Electromagnetic Complience EMC and Elevtromagnetic Interference EMI requirements as set by IEX60601, Electrical Safety1-1.

### 1.11 [SysOP-61-C11] Subsection Supply
The system shall be able to privide power to the system through the control subsystem without power drop out or failure.

### 1.12 [SysOP-61-C12] Power Cable Clamp
The system shall have a cable that keep the power cable connected to the system.

## 2 [SyOPS-62] Control Subsystem Primary Monitor
The Control Sub-system shall be capable of performing all the primary monitoring and control functions of the BVS.
Keywords: HMI Control

### 2.1 [SyOPS-62-C1] Presssuer over time
Pressure ramp option that starts pressure at low level (minimum) and increases slowly over time priod to set level (User set maximum).

### 2.2 [SyOPS-62-C2] Spontanious Timing
The BVS shall react to spontanious timing in reaction to the breathing of the patient.

### 2.3 [SyOPS-62-C3] Rebreathing
The system shall account for 4 to 5 millimeters of CO2 rebreathing.

### 2.4 [SyOPS-62-C4] APAP
The system shall allow for automatic positive airway pressure also called AutoPAP or APAP

### 2.5 [SyOPS-62-C5] CPAP
The system shall be CPAP spontanious for a time (T) Pressure Assisted Control/Pressure COntrole (PAC/PC)

### 2.6 [SyOPS-62-C6] Inspirator and Exiratory
The system shall allow for the programmable time functions for inspiratory and expiratory

### 2.7 [SyOPS-62-C7] Rise Time to Peak Flow
The system shall be controlled ro prevent massive increase in airflow, variable rate shall be selectable.

### 2.8 [SyOPS-62-C8] Inspiration to Expiration
The system shall allow the fan to operate at 30% to 50% of the peak flow rate.

### 2.9 [SyOPS-62-C9] Exspiration to Insiration
The system shall allow for the flow to chang eercentage when inspiration is trggered to peak flow cycle.

### 2.10 [SyOPS-62-C10] Operation
The system shall operate without fail for a minimum period of 14 days.

### 2.11 [SyOPS-62-C11] Low Level Alarm
The system shall trigger an low level alarm when a low catagory failure occures while device continues function on last preset with limited capabilities.

### 2.12 [SyOPS-62-C12] High Levle Alarm
The system shall trigger a high level alarm when critical failure in a main component failure, built in safty systems shall open the patient circuit to prevent obstruction.

### 2.13 [SyOPS-62-C13] Start-Up
The system shall send start up function to the HMI when system is power up.

### 2.14 [SyOPS-62-C14] Self Test
The system shall be capable of iniciting self testing procedure when triggered by HMI.

### 2.15 [SyOPS-62-C15] Information Set
The system shall allow for the medical practitioner to set the operations

### 2.16 [SyOPS-62-C16] Initiate Therapy
The system shall when triggeed by the medical practitioner inicicate the preset therapy to the patient iniciating ventilation from the Air Supply Subsystem.

### 2.17 [SyOPS-62-C17] Auditory Check
The system shall detect auditory feedback via a mic or LDR.

### 2.18 [SyOPS-62-C18] Maintinance Mode Trigger
The system shall be capable of entering maintainance when both button and password have been triggered.

### 2.19 [SyOPS-62-C19] Monitoring
The system shall provide the HMI with monitoring infomation of the patient and system.

### 2.20 [SyOPS-62-C20] Shut Down Mode
the system shall allow the operator to shutdown the unit from the HMI provided the system has not locked out shutdown either physcally or in software.

### 2.21 [SyOPS-62-C21] Lock out
The system shall allow the operator to physically or in software allow for locking shutdown sequence

### 2.22 [SyOPS-62-C22] Shutdown Routine
The system shall enter standby mode and apon wake up or turning on the system shal go inti Start-up mode.

### 2.23 [SyOPS-62-C23] Self Fuction from Software
The system shall allow for self testing procedure when triggered by HMI.

### 2.24 [SyOPS-62-C24] Maintainance Self Test
The system shall allow for self testing procedure during maintainance mode

### 2.25 [SyOPS-62-C25] Low Pressure Alarm
The system shall allo for the setting of the low pressure alarm through the HMI by the operator or support equipment.

### 2.26 [SyOPS-62-C26] Scalable Pressure Alarm
The system shall allow for the alarm state to be monitored and escilated if the alarm has not clear within a time period.

### 2.27 [SyOPS-62-C27] Alarm Trigger System Failure
The system shall trigger high level alarm when system failure is detected.

### 2.28 [SyOPS-62-C28] Alarm Trigger Power Failure
The system shall trigger low level alarm when mains power is unavaiable.

### 2.29 [SyOPS-62-C29] Alarm Trigger Battery Back Up Failure
The system shall allow for High Level alarm trigger when battery backup is low on power and main power is unavailable.

### 2.30 [SyOPS-62-C30] Technical Alarm
The system shall be abke to trigger a technical alarm.

### 2.31 [SyOPS-62-C31] Equipment Alarm
The system shall allow for high level alarm for leak detection.

### 2.32 [SyOPS-62-C32] Service Alarm
System shall trigger technical alram and show service needed on HMI 1 month before service date

### 2.33 [SyOPS-62-C33] Air Filter Alarm
The system shall trigger air filter replacement technical alram and display on HMI.

### 2.34 [SyOPS-62-C34] Alarm Set
The alarms shall be set to system defult within tqo minutes of startup

### 2.35 [SyOPS-62-C35] Silence Alarm
The system shall allow to alarms to be silenced for a maximum of two minutes.

### 2.36 [SyOPS-62-C36] Patient Alarm Cancle
The system shall allow for the alarm to be cleared once the patient has take three full breaths.

### 2.37 [SyOPS-62-C37] Self Test Method
The system shall condcut the self test automatically during startup or when actioned by the user through the HMI

### 2.38 [SyOPS-62-C38] Instructions
The system shall provide the procedures to do self test in the manual.

### 2.39 [SyOPS-62-C39] Healthcare Instructions
The system shall provide a test method for the healthcare operator.

### 2.40 [SyOPS-62-C40] Internal Timer
The system shall have an internal timer for various actons to take place.

### 2.41 [SyOPS-62-C41] Operator Control IPAP
The system shall allow the operator to control the Inhalation Pressure (IPAP) from the HMI

### 2.42 [SyOPS-62-C42] Exhalation Pressure EPAP
The system shall allow the operator to control the Exhalation Pressure (EPAP) through the HMI

### 2.43 [SyOPS-62-C43] Apnoea Period
The system shall allow the operator to control the Apnoea Period through the HMI

### 2.44 [SyOPS-62-C44] Inspired Oxygen Proportion (FiO2)
The system shall allow the operator to control the Inspired Oxygen Proportion (FiO2) through the HMI

### 2.45 [SyOPS-62-C45] Inspirtory Trigger Pressure
The system shall allow the operator to control the Inspritory trigger based on pressure through the HMI

### 2.46 [SyOPS-62-C46] Time to Peak flow
The system shall allow the operator to control the Time th Peak Flow through the HMI

### 2.47 [SyOPS-62-C47] Inspiratory Trigger Range
The system shall allow for the inpritory trigger range from -0.5 to -15 cmH2O

### 2.48 [SyOPS-62-C48] Two Pressure Settings
The system shall allow for two pressure settings being Inhalation (IPAP) and Exhalation (EPAP).

### 2.49 [SyOPS-62-C49] Spontanious Inhalation Patient Iniciated
The system shall allow the operator to set the apnoea threshhold through the HMI for the alarm trigger.

### 2.50 [SyOPS-62-C50] Inspiration Oxygen Proportion (FiO2)
The system shall allow the operator through the HMI to set the inspired oxygen proportion (FiO2) of the gass supplied to the patient from 21% to 100% in set incements of 10% or with a contious slider with an accuracy of 5%.

### 2.51 [SyOPS-62-C51] Flow Rate
The system shall allow the operator through the HMI to set the average flow rate from 10 to 80 L/min with limit of PEEP of 4 to 20 cmH2O

### 2.52 [SyOPS-62-C52] Pressure Range IPAP
The system shall allow the pressure of the IPAP to be set from 4 to 25 cmH2O

### 2.53 [SyOPS-62-C53] Pressure Range EPAP (PEEP)
The system shall allow for the EPAP (PEEP) to be set on the range of 4-20 cmH2O

### 2.54 [SyOPS-52-C54] Pressure Range CPAP
The system shall allow for the range to be set within 4-15 cmH2O

### 2.55 [SyOPS-52-C55] Data Logging Monitoring
The system shall data log all monitored Items from the HMI keeping the information saved

### 2.56 [SyOPS-52-C56] Data Download
The system shall allow for the data captured in the monitring system to be downloaded for analysis.

### 2.57 [SyOPS-52-C57] Technical Alarm High Priority
The system shall allow for the high priority technical alarm to be cleared by medical personal but is to be recored then alwarm is sileced and acknowladged.

## 3 [SyOPS-63] HMI Primary control and interface
The HMI Sub-system shall be the primary display and control interface between the medical operator and the BVS.

### 3.1 [SyOPS-63-C1] Trigger Sensativity cmH2O
The system shall allow for the HMI to have a trigger sensativaty of 1-10 cmH2O in incroments of 1 cmH2O or be automatic.

### 3.2 [SyOPS-63-C2] Start-up Screen
The system shall have a start up screen sequence when powered on.

### 3.3 [SyOPS-63-C3] Start-up Prompt Self Test
The system shall allow the user to start the mantidory self test process on the HMI.

### 3.4 [SyOPS-63-C4] Start-up Predefine Setting Screen
The system shall show a screen of predefined peramiters for the ventilator that may be edited for each setting that is elable for change by the health practitioner.

### 3.5 [SyOPS-63-C5] Start-up Balance System
The system shall allow for chnges to be saved in the startup process where all changes will be shown and confirmed.

### 3.6 [SyOPS-63-C6] Start-up Black Box
The system shall record all the changes that were within safe messure and monitor errors on the HMI.

### 3.7 [SyOPS-63-C7] Start-up Iniciate Therapy
The system shall allow for the confirmation of iniciation of ventilating therapy for patient.

### 3.8 [SyOPS-63-C8] Maintenance Mode Notification and Password
The system shall inform the operator on the HMI that the system has entered maintenance mode and qill promt for a code to enter maintenance.

### 3.9 [SyOPS-63-C9] Practicioners Settings
While ventilating the setting f=of the practioner shall be locked with a key that the practioner has set.

### 3.10 [SyOPS-63-C10] Calibration Test
The system shall be capable of running a calibration test (through the self test) through the HMI.

### 3.11 [SyOPS-63-C11] Monitoring with HMI
The system shall allow for system monitoring through the HMI/user interface.

### 3.12 [SyOPS-63-C12] Monitered Parameters
The system shall allow for selected parameters to be monitored on the HMI.

### 3.13 [SyOPS-63-C13] Touch Screen
The system shall utilise a touch screen interface for the HMI.

### 3.14 [SyOPS-63-C14] Screen Clean
The system shall have a touch screen that can be ceaned and disinfected without damage.

### 3.15 [SyOPS-63-C15] Screen Size
The system shall utilise a screen that is 7" or 10" in diameter.

### 3.16 [SyOPS-63-C16] Pernament Monitors
The system shall have the following peramitors pernamently shown on the monitor, pressure, flow and volume in a graphic scaler.

### 3.17 [SyOPS-63-C17] Screen Brightness
The system shall have a brightnerss that is ledgable in direct sunlight.

### 3.18 [SyOPS-63-C18] Daylight mode
The system shall allow for the chnage to nondaylight and daylight mode.

### 3.19 [SyOPS-63-C19] Lung Graphics
The system shall have graphics of the lungs during ventilation.

### 3.20 [SyOPS-63-C20] Setting Profile
The system shall allow for resumption onthe previous user set settings that is saved to the profile.

### 3.21 [SyOPS-63-C21] Failure HMI Prompt
The system shall allow the HMI to visually shaow a failure and the type with information on the failure to appear, the HMI will also allow for the silencing prompt of the alarm (while inline of the settings of the system for the level of alarm)

### 3.22 [SyOPS-63-C22] Secondary Input
The system shall allow for a secondary input through a control knob.

### 3.23 [SyOPS-63-C23] Control IPAP
The system shall allow for the operator to set the perameters in the HMI of Inhalation Pressure (IPAP) while being able to control the settings.

### 3.24 [SyOPS-63-C24] Apnoea Period HMI
The system shall allow for the operator to set and manage the apnoea time period.

### 3.25 [SyOPS-63-C25] Inspired Oxygen HMI
The system shall allow the user to set the inspired oxygen proprtion (FiO2).

### 3.26 [SyOPS-63-C26] Exhalation Pressure (EPAP)
The system shall allow for the operator to set the exhalation Pressure (EPAP).

### 3.27 [SyOPS-63-C27] Inspiratory Trigger Pressure Set
The system shall allow for the operator to set the Inspiration trigger point through the HMI.

### 3.28 [SyOPS-63-C28] Peak Flow Time Set
The system shall allow the operatore to set the time to peak flow through the HMI.

### 3.29 [SyOPS-63-C29] Insparatory Trigger Range
The system shall allow the operatore to set the inspiratory trigger from -0.5 to -15 cmH2O through the HMI.

### 3.30 [SyOPS-63-C30] Pressure setting
The system shall allow the operatore to set the IPAP and EPAP seperately through the HMI.

### 3.31 [SyOPS-63-C31] Apnoea Alarm Set
The system shall allow the operatore to set the apnoea alarm limit from 10 to 40 seconds through the HMI. (NVP F.1.4)

### 3.32 [SyOPS-63-C32] FiO2 Percentage Set
The system shall allow the operatore to set the inspired oxygen proportion (FiO2) from 21% to 100% with accuracy of 5% through the HMI. (NVP F.7.1)

### 3.33 [SyOPS-63-C33] IPAP Setting Range
The system shall allow the operatore to set the IPAP from 4-25 cmH2O through the HMI.

### 3.34 [SyOPS-63-C34] EPAP Setting Range
The system shall allow the operatore to set the EPAP from 4 to 20 cmH2O through the HMI.

### 3.35 [SyOPS-63-C35] CPAP Setting Range
The system shall allow the operatore to set the CPAP from 4 to 15 cmH2O through the HMI.

### 3.36 [SyOPS-63-C36] Monitor IPAP and EPAP
The system shall allow for the monitoring of IPAP and EPAP through the HMI.

### 3.37 [SyOPS-63-C37] Monitoring FiO2
The system shall allow for the monitoring of FiO2 through the HMI.

### 3.38 [SyOPS-63-C38] Monitoring MAP
The system shall allow for the monitoring of Mean Airway Pressure (MAP) through the HMI.

### 3.39 [SyOPS-63-C39] Monitor Time to Peak Pressure
The system shall allow for the monitoring of Time to Peak Pressure through the HMI.

### 3.40 [SyOPS-63-C40] Monitor Inspiration and Expiration Ratio
The system shall allow for the monitoring of Inspiration and Exparation Ratio through the HMI.

### 3.41 [SyOPS-63-C41] Monitor All Variables
The system shall allow for the monitoring of all variable that have been set through the HMI.

### 3.42 [SyOPS-63-C42] Monitor PEEP Pressure
The system shall allow for the monitoring of PEEP Pressure through the HMI.

### 3.43 [SyOPS-63-C43] Monitoring Expiratory Flow Time and Pressure Time
The system shall allow for the monitoring of Expiratory Flow and Pressure Time through the HMI.

### 3.44 [SyOPS-63-C44] Monitor Expired Breath Volume
The system shall allow for the monitoring of Expird Breath Volume through the HMI.

### 3.45 [SyOPS-63-C45] Display Mode Preference
The system shall allow the operator to choose the prefered display mode of the HMI.

### 3.46 [SyOPS-63-C46] Alarm Pop-ups
The system shall display alarm pop-ups when an alarm has been triggered by the control system on the HMI

### 3.47 [SyOPS-63-C47] Test Manuals
The system shall allow access to the test manuals through the HMI.

### 3.48 [SyOPS-63-C48] Test Accessories
The system shall allow the operator to test the tubing and accessories from the HMI.

### 3.49 [SyOPS-63-C49] Test Power
The system shall allow for the operator to switch from main power to battery to test switching capabilaties within the HMI.

### 3.50 [SyOPS-63-C50] Alarm Test
The system shall allow for all alarm signals and operations to be tested through the HMI.

### 3.51 [SyOPS-63-C51] Circuit Test
The system shall allow the operator to test the circuit disconnect alarm within the HMI.

### 3.52 [SyOPS-63-C52] Button Test
The system shall allow for the operator to test button verification through the HMI

### 3.53 [SyOPS-63-C53] Alarm Visual and Audiable Test
The system shall allow the operator to test all alarm visuals and alarm tones through the HMI.

### 3.54 [SyOPS-63-C54] Service Reminder and Check
The system shall allow the operator to check when a service is due and get a reminder on month before for service through the HMI.

### 3.55 [SyOPS-63-C55] QR Code Manual LInk
The system shall allow for the operator tp access the user manual via the QR Code trough the HMI.

### 3.56 [SyOPS-63-C56] Blower Life Time Indicator
The system shall allow the operator to see the life time inidcator of the blower through the HMI.

## 4 [SyOPS-65] Alarm Subsystem alarm activation
The Alarm Sub-system shall be capable of actuation of all the alarms of the BVS.

### 4.1 [SyOPS-65-C1] Alarm Peak Pressure
The alarm will trigger when a pressure of 40 cmH2O

### 4.2 [SyOPS-65-C2] Low Catagory Failure
The system shall trigger a low level alarm when triggered by the control system.

### 4.3 [SyOPS-65-C3] Alarm Critical Failure
The system shall allow for critical alarm to be triggered by the control system.

### 4.4 [SyOPS-65-C4] Visual and Audio
The system shall trigger both audiable and visual ques

### 4.5 [SyOPS-65-C5] Low Level Visual Alarm
The system shall visually indicate low level alarm with an orange LED.

### 4.6 [SyOPS-65-C6] High Level Visual Alarm
The system shall visually indicate high level alarm with a red LED.

### 4.7 [SyOPS-65-C7] Technical Visual Alarm
The system shall visually indicate a technical alarm with a blue LED.

### 4.8 [SyOPS-65-C8] Alarm Access
The system shall allow for the operator to access the perameters of the alarm.

### 4.9 [SyOPS-65-C9] Alarm Volume
The system shall be locked so it can not be altered by operators

### 4.10 [SyOPS-65-C10] Perameters Locked
The system shall lock all peramiters of the alarm other than trigger points.

### 4.11 [SyOPS-65-C11] Alarm Descibel Scale
The system shall be capable of scalable in decible level or tone when not addressed for two minutes.

### 4.12 [SyOPS-65-C12] Number of Alarms
The system shall be limited to three catagories of alarms (technical low level and high level)

### 4.13 [SyOPS-65-C13] Alarm Limits Violated
The system shall trigger the alarm if the limits have been violated

### 4.14 [SyOPS-65-C14] Breathing Alarm
The system shall trigger a high level alarm when the patient shows no breathing effort (NVP F.13.1).

### 4.15 [SyOPS-65-C15] High Low Pressure
The system shall trigger the high level alarm if the pressure of the system is outside of the preset high or low range.

### 4.16 [SyOPS-65-C16] Breathing Circuit
The system shall trigger a high level alarm when the patient breathing circuit is abruptly disconnected.

### 4.17 [SyOPS-65-C17] Oxygen Supply Failure
The system shall trigger a high level alarm when an oxygen supply failure is detected.

### 4.18 [SyOPS-65-C18] Air Supply Failure
The system shall trigger a high level alarm when the air supply has failed.

### 4.19 [SyOPS-65-C19] Apnoea Alarm
The system shall trigger a high level alarm when apnoea is detected by the control system.

### 4.20 [SyOPS-65-C20] High Insieration Rate
The system shall trigger a low level alarm when high breathing rate is measured.

### 4.21 [SyOPS-65-C21] High Level Alarm Clear
The system shall only allow for high level alarms to be clear only when issue has been resolved.

### 4.22 [SyOPS-65-C22] Technical Type of Alarm
The system shall trigger a techniical alarm when battery is running low or service is needed.

### 4.23 [SyOPS-65-C23] Low Level Alarm Type
The system shall trigger a low level trigger when minor peramiters set by the operator are violated.

### 4.24 [SyOPS-65-C24] High Level Alarm Type
The system shall trigger the high level alarm when a system debiliting error ocures.

## 5 [SyOPS-66] RMT Subsystem Provide information
The Remote monitoring Sub-system shall be capable of providing BVS information to a remote terminal.

### 5.1 [SyOPS-66-C1] Remote Monitor
The system shall allow for the system to monitored in a location that is convinient for the operator.

### 5.2 [SyOPS-66-C2] Mirror
The system shall mirror the monitoring screen of the screen on the ventilator.

## 6 [SyOPS-67] Air Supply Subsystem Air mix
The Air Supply Sub-system shall be capable of selecting mixing and regulating the ventilator air stream.

### 6.1 [SyOPS-67-C1] Constant Air Supply
The system shall supply air on its own without need of the air supply unit being connected.

### 6.2 [SyOPS-67-C2] Medical Air
The system shall have an internal blower that can contiue the operation when medical air is not supplied or run without the need of medical air.

### 6.3 [SyOPS-67-C3] Air Mix
The system shal be capable of micing oxygen into the ambient airflow.

### 6.4 [SyOPS-67-C4] Blower Peak Flow
The system shall be capable of delievering a maximum of 160L/min of mixed air with compensation for leakage.

### 6.5 [SyOPS-67-C5] Pressure
The system shall be capable of delievering the flow rate at the set pressure from the control system.

### 6.6 [SyOPS-67-C6] Normal Use Range
The normal use range of the system shall be capable of operating without failure betweeen 80 to 100L/min.

### 6.7 [SyOPS-67-C7] Noise
The system shall operate between 80 to 100L/min with a noise level of 35dBA (or lower) at a distance of one meter.

### 6.8 [SyOPS-67-C8] Flow Rate
The system shall be capable of providing a flow rate of 80 to 260 L/min to compensate for air leakages.

### 6.9 [SyOPS-67-C9] Turbine high flow rate
The system shall have a turbine that does not limit at 260L/min to avoid wearout.

### 6.10 [SyOPS-67-C10] Flow Genarator
The system shall utilise a software signal flow genarator to manipulate air flow.

### 6.11 [SyOPS-67-C11] No Medical Air
The system shall function in the absence of medical air.

### 6.12 [SyOPS-67-C12] Dual System
The system shall be able to supply air and gas.

### 6.13 [SyOPS-67-C13] Ambient Air Inlet
The system shall filter the ambient air inlet such no impuraties can enter the patients air ways.

### 6.14 [SyOPS-67-C14] Oxygen Addition
The system shall add oxygen within the air suply unit.

## 7 [SyOPS-68] Patient Subsystem Provide BiPAP air
The Patient Interface Sub-system shall be capable of providing BiPAP air to the patient.

### 7.1 [SyOPS-68-C1] Oxygen Nasal Inlet
The system shall allow for the patient mask for nasal oxygen inlet.

### 7.2 [SyOPS-68-C2] Pressure Suplied
The system patient interface shall allow for pressure of 200-500Kpa (NVP 1.3)

### 7.3 [SyOPS-68-C3] Hose
The hose from the system shall have a three meter long hose that can withstand the pressure.

### 7.4 [SyOPS-68-C4] Oxygen Outlet
The system shall be able to connect to the standard (South African 2021) wall outlet cylinder.

### 7.5 [SyOPS-68-C5] Air Switch
The system shall be capable of switching from hosital supplied medical air and turbine supplied ambient air.

### 7.6 [SyOPS-68-C6] Gas Connectors and Hoses
The system shall abide by ISO7396-1:2016 medical gas pipeline systems-Part 1: Pipeline systems for compressed medical gases and vacuum.

### 7.7 [SyOPS-68-C7] Outlet and Probes
The system shall abide to SANS 1409:2014 Outlet sockets and probes for medical (gas and vacuum) services used in hospitals,

### 7.8 [SyOPS-68-C8] Cones and Sockets
The system shall abide by ISO: 5356-1:2015 Anaesthetic and respository equipment - Conical connectors- Part 1: Cones and sockets

### 7.9 [SyOPS-68-C9] Breathing Gas Pathway
the system shall allow for the assembling of the breathing gas pathway, including connection of the detachable parts of the gas pathway to the air supply subsystem

### 7.10 [SyOPS-68-C10] Humidifier Attach
The system shall have the capability of connecting of a humidifier to the patient interface as an external system.

### 7.11 [SyOPS-68-C11] Mask Size
The system shall make use of a full face mask or half face mask.

### 7.12 [SyOPS-68-C12] Mask Comfert
The system shall have a mask that mitigates chances of sores when resting on the patients face.

### 7.13 [SyOPS-68-C13] Humidifier
The system shall when humidifying via external meas humidify by the inspired gas actively (servo controlled heated humidifier) or heat and moisture exchange filyer (HMEF) at the patient interface (NVP F.8.1).

### 7.14 [SyOPS-68-C14] External Humidifier
The system shall allow for the addition of a humidifier on the patient interfce and not an internal humidifier.

### 7.15 [SyOPS-68-C15] Bacteria Filter
The system shall have a bacterial filter in the patient interface.

### 7.16 [SyOPS-68-C16] Nasal Mask
The system shall be provided with a nasal mask for adult abd paediatric with relavaent tubing.

### 7.17 [SyOPS-68-C17] Oral Mask
The system shall provide a oral mask for adult and paediatric.

### 7.18 [SyOPS-68-C18] Single Use
The instraments that come into contact with the patient will be treated as single use consumables and other elements shall be able to withstand harsh disinfectant chemicals.

### 7.19 [SyOPS-68-C19] Harmful Consumable
The system shall avoid or account for consumables that may cause additional damage to the patient.

### 7.20 [SyOPS-68-C20] Manditory filter
The system shall have a manditory bacteria filter with reusable accessories.

### 7.21 [SyOPS-68-C21] Nasal Mask Clean
The system shall utilise adult and paediatric nasal mask and tubing that can be cleaned with high level disinfectants and sterilization.

### 7.22 [SyOPS-68-C22] Oral Mask Clean
The system shall utilise adult and paediatric oral mask and tubing that can be cleaned with high level disinfectants and sterilization.

### 7.23 [SyOPS-68-C23] Helmet Clean
The system shall utilise adult and paediatric helmet and tubing that can be cleaned with high level disinfectants and sterilization.

### 7.24 [SyOPS-68-C24] Connectors
The system shall allow for connectors for air and oxygen outlets, asaptable for most connectors including barb, NF, DISS and NIST.

### 7.25 [SyOPS-68-C25] Hose Clamp
The system shall include a hose clamp that keep hose secured to the system.